# Grasshopper definition FINAL PROYECT.gh (Grasshopper 1.0.7)

# ---- group: Curved structure
web_depth = Slider(0.88, range=0..3)
width_section = Slider(0.42, range=0..1)
bracket_height = Slider(2.6, range=0..5)
flange_thickness = Slider(0.043, range=0..0.2)
web_thickness = Slider(0.025, range=0..0.2)

# ---- group: Base
# PARAMETRIC MODEL : ORIENTE STATION LISBOA
# 01
# Final practice: Introduction to Parametric Modeling
# Módulo de arbol
# Part
# Josué Israel Hurtado Mujica
# Course by: ParametricCamp
x_y_size = Slider(1.55, range=0..4)
height = Slider(10.82, range=0..15)

# ---- group: Roof structure
slope = Slider(4.854, range=0..10)
height_2 = Slider(0.17, range=0..1)
leght = Slider(0.29, range=0..1)

# ---- group: Purlins
number_slider = Slider(12, range=0..30)
number_slider_2 = Slider(0.1, range=0..0.2)

# ---- group: Linear beam
height_3 = Slider(0.68, range=0..1)

# ---- group: Canopy glass
thickness = Slider(0.301, range=0..0.4)

# ---- group: Main mast
radius_mast = Slider(0.1, range=0..0.5)
height_mast = Slider(11.01, range=0..40)

# ---- group: CONSTRUCT BASE
expression = Expression(x=x_y_size, Expression="- x / 2")
expression_2 = Expression(x=x_y_size, Expression="+ x / 2")
xy = XYPlane(Origin=Point(0, 0, 0))
dom = ConstructDomain(DomainStart=expression_2, DomainEnd=expression)
box = DomainBox(Base=xy, X=dom, Y=dom, Z=height)

# ---- group: Base origin points
box_corners = BoxCorners(Box=box)  # -> CornerA, CornerB, CornerC, CornerD, CornerE, CornerF, CornerG, CornerH
ln = Line(StartPoint=box_corners.CornerE, EndPoint=box_corners.CornerH)
ln_2 = Line(StartPoint=box_corners.CornerF, EndPoint=box_corners.CornerG)

# ---- group: Base
brep = Brep(box)

# ---- group: Unions
width = Slider(0.7, range=0..1)
height_4 = Slider(0.37, range=0..1)

# ---- group: Origen point coordinates
number_slider_3 = Slider(1, range=0..1)
number_slider_4 = Slider(0.35, range=0..1)

# ---- group: Number of quads
u_v_count = Slider(79, range=0..100)

# ---- group: Rows and columns
number_x = Slider(4, range=0..30)
number_y = Slider(12, range=0..30)

# ----
# PARAMETRIC MODEL : ORIENTE STATION LISBOA
# 02
# Final practice: Introduction to Parametric Modeling
# Inserción en el terreno
# Part
# Josué Israel Hurtado Mujica
# Course by: ParametricCamp
srf = Surface(<surface referenced from the Rhino model>)

# ---- group: ON SITE IMPLEMENTATION / Origen point
pt = ConstructPoint(XCoordinate=number_slider_4, YCoordinate=number_slider_3, ZCoordinate=0)

# ---- group: ON SITE IMPLEMENTATION / SURFACES
expression_3 = Expression(x=number_x, Expression="X - 1")
expression_4 = Expression(y=number_y, Expression="y - 1")

# ---- group: ON SITE IMPLEMENTATION / Point location on mesh
evalsrf = EvaluateSurface(Surface=reparameterize(srf), Point=pt)  # -> Point, Normal, UDirection, VDirection, Frame

# ---- group: ON SITE IMPLEMENTATION / Convert to mesh
mesh_uv = MeshSurface(Surface=srf, UCount=u_v_count, VCount=u_v_count, Overhang=True, Equalize=False)

# ----
base_height = Data(height)

# ---- group: Representation mesh / Extract points
sdivide = DivideSurface(Surface=srf, UCount=u_v_count, VCount=u_v_count)  # -> Points, Normals, Parameters
pdecon = Deconstruct(Point=sdivide.Points)  # -> XComponent, YComponent, flatten(ZComponent)

# ---- group: Representation mesh / Color parameters
bnd = Bounds(Numbers=pdecon.ZComponent)
remap = RemapNumbers(Value=pdecon.ZComponent, Source=bnd, Target=Domain(0, 1))  # -> Mapped, Clipped
gradient = Gradient(LowerLimit=0, UpperLimit=1, Parameter=remap.Mapped, stops=[0: RGB(0, 128, 0), 0.5: RGB(255, 255, 0), 1: RGB(255, 0, 0)])

# ---- group: Representation mesh / Extract faces and vertices
demesh = DeconstructMesh(Mesh=mesh_uv)  # -> Vertices, Faces, Colours, Normals

# ---- group: Representation mesh / Color code mesh
conmesh = ConstructMesh(Vertices=demesh.Vertices, Faces=demesh.Faces, Colours=gradient)

# ---- group: Curvature control
x_first_point = Slider(0.98, range=0..5)
z_first_point = Slider(3.25, range=0..10)
x_second_point = Slider(1.63, range=0..10)
z_second_point = Slider(8.49, range=0..20)
x_final_point = Slider(6.09, range=0..15)
z_final_point = Slider(12.19, range=0..30)

# ---- group: CURVED STRUCTURE / WEB / "IF" for counter error
smaller = SmallerThan(FirstNumber=z_final_point, SecondNumber=height_mast)  # -> SmallerThan, OrEqualTo
larger = LargerThan(FirstNumber=z_final_point, SecondNumber=height_mast)  # -> LargerThan, OrEqualTo
neg = Negative(Value="0")
division = Division(A=expression, B="2")
cull = CullPattern(List=[division, neg], CullPattern=[larger.LargerThan, smaller.OrEqualTo])

# ---- group: CURVED STRUCTURE / TOP FLANGE / Flange central curve
midpt = CurveMiddle(Curve=ln_2)
vec = VectorXYZ(XComponent=x_first_point, YComponent=0, ZComponent=z_first_point)  # -> Vector, Length
vec_2 = VectorXYZ(XComponent=x_second_point, YComponent=0, ZComponent=z_second_point)  # -> Vector, Length
vec_3 = VectorXYZ(XComponent=x_final_point, YComponent=0, ZComponent=z_final_point)  # -> Vector, Length
move = Move(Geometry=midpt, Motion=vec.Vector)  # -> Geometry, Transform
move_2 = Move(Geometry=midpt, Motion=vec_2.Vector)  # -> Geometry, Transform
move_3 = Move(Geometry=midpt, Motion=vec_3.Vector)  # -> Geometry, Transform
nurbs = NurbsCurve(Vertices=[midpt, move.Geometry, move_2.Geometry, move_3.Geometry], Degree=3, Periodic=False)  # -> Curve, Length, Domain

# ---- group: Curvature control (continued)
firts_control_point = Point(move.Geometry)
second_control_point = Point(move_2.Geometry)
final_curve = Point(move_3.Geometry)

# ---- group: MAIN MAST
midpt_2 = CurveMiddle(Curve=ln)
ln_3 = Line(StartPoint=midpt, EndPoint=midpt_2)
midpt_3 = CurveMiddle(Curve=ln_3)
cyl = Cylinder(Base=midpt_3, Radius=radius_mast, Length=height_mast)

# ---- group: ROOF STRUCTURE / Roof base geometry
Z = UnitZ(Factor=height_mast)
move_4 = Move(Geometry=midpt_3, Motion=Z)  # -> Geometry, Transform
addition = Addition(A=expression_2, B=x_final_point)
subtraction = Subtraction(A=expression, B=x_final_point)
xy_2 = XYPlane(Origin=move_4.Geometry)
dom_2 = ConstructDomain(DomainStart=subtraction, DomainEnd=addition)
rectangle = Rectangle(Plane=xy_2, XSize=dom_2, YSize=dom_2, Radius=0)  # -> Rectangle, Length

# ---- group: CURVED STRUCTURE / TOP FLANGE / Flange side curves
expression_5 = Expression(x=x_y_size, factor=width_section, Expression="(x / 2) * factor")
subtraction_2 = Subtraction(A=expression_2, B=expression_5)
addition_2 = Addition(A=expression, B=expression_5)
Y = UnitY(Factor=subtraction_2)
Y_2 = UnitY(Factor=addition_2)
move_5 = Move(Geometry=nurbs.Curve, Motion=Y_2)  # -> Geometry, Transform
move_6 = Move(Geometry=nurbs.Curve, Motion=Y)  # -> Geometry, Transform

# ---- group: ROOF STRUCTURE / Points extraction
box_corners_2 = BoxCorners(Box=rectangle.Rectangle)  # -> CornerA, CornerB, CornerC, CornerD, CornerE, CornerF, CornerG, CornerH
pt_2 = Point([box_corners_2.CornerA, box_corners_2.CornerB, box_corners_2.CornerC, box_corners_2.CornerD])

# ---- group: CURVED STRUCTURE / WEB / Curvature generation points
neg_2 = Negative(Value=web_depth)
addition_3 = Addition(A=expression, B=neg_2)
X = UnitX(Factor=addition_3)
X_2 = UnitX(Factor=cull)
move_7 = Move(Geometry=move_2.Geometry, Motion=X)  # -> Geometry, Transform
move_8 = Move(Geometry=midpt, Motion=X)  # -> Geometry, Transform
move_9 = Move(Geometry=move.Geometry, Motion=X)  # -> Geometry, Transform
move_10 = Move(Geometry=move_3.Geometry, Motion=X_2)  # -> Geometry, Transform

# ---- group: CANOPY GLASS / Curves of all directions
panel = Panel("""0
90
180
270""")
rad = Radians(Degrees=panel)
xy_3 = XYPlane(Origin=move_4.Geometry)
data = Data(move_3.Geometry)
rotate = Rotate(Geometry=data, Angle=rad, Plane=xy_3)  # -> Geometry, Transform

# ---- group: ROOF STRUCTURE / Structure cornes
Z_2 = UnitZ(Factor=slope)
move_11 = Move(Geometry=pt_2, Motion=Z_2)  # -> Geometry, Transform

# ---- group: ROOF STRUCTURE / Base plans for profile
panel_2 = Panel("""315
225
135
45""")
rad_2 = Radians(Degrees=panel_2)
xz = XZPlane(Origin=move_4.Geometry)
xy_4 = XYPlane(Origin=move_4.Geometry)
rotate_2 = Rotate(Geometry=xz, Angle=rad_2, Plane=xy_4)  # -> Geometry, Transform

# ---- group: CURVED STRUCTURE / WEB / Points for intersection curve
X_3 = UnitX(Factor=radius_mast)
move_12 = Move(Geometry=midpt_3, Motion=X_3)  # -> Geometry, Transform
Z_3 = UnitZ(Factor=height_mast)
move_13 = Move(Geometry=move_12.Geometry, Motion=Z_3)  # -> Geometry, Transform

# ---- group: CURVED STRUCTURE / TOP FLANGE / Flange base curves
right_curve = Curve(move_6.Geometry)
left_curve = Curve(move_5.Geometry)
central_curve = Curve(nurbs.Curve)

# ---- group: CANOPY GLASS / Origin points
roof_structure_points = Point(move_11.Geometry)
central_point = Point(move_4.Geometry)
beams_points = Point(rotate.Geometry)

# ---- group: BEAMS / mast shaft end
pt_3 = Point(move_4.Geometry)

# ---- group: ROOF STRUCTURE / Structure section
expression_6 = Expression(x=height_2, Expression="x / 2")
expression_7 = Expression(x=leght, Expression="x / 2")
neg_3 = Negative(Value=expression_7)
neg_4 = Negative(Value=expression_6)
dom_3 = ConstructDomain(DomainStart=neg_4, DomainEnd=expression_6)
dom_4 = ConstructDomain(DomainStart=neg_3, DomainEnd=expression_7)
rectangle_2 = Rectangle(Plane=rotate_2.Geometry, XSize=dom_4, YSize=dom_3, Radius=0)  # -> graft(Rectangle), Length

# ---- group: CURVED STRUCTURE / TOP FLANGE / Find curve parameters at given height
xy_5 = XYPlane(Origin=box_corners.CornerF)
Z_4 = UnitZ(Factor=bracket_height)
move_14 = Move(Geometry=xy_5, Motion=Z_4)  # -> Geometry, Transform
pcx = CurvePlane(Curve=[right_curve, left_curve], Plane=move_14.Geometry)  # -> Points, ParamsC, ParamsP

# ---- group: BEAMS / Web generation
ln_4 = Line(StartPoint=pt_3, EndPoint=move_3.Geometry)
Z_5 = UnitZ(Factor=height_3)
move_15 = Move(Geometry=ln_4, Motion=Z_5)  # -> Geometry, Transform
loft = Loft(
    Curves=[move_15.Geometry, ln_4],
    Options={Adjust=False, Closed=False, LoftEnds=0, LoftSimp=0, LoftType=0, Rebuild=10, Refit=0.01})

# ---- group: ROOF PURLIN / Beam axis
division_2 = Division(A=height_3, B="2")
Z_6 = UnitZ(Factor=division_2)
crv = Curve(ln_4)
move_16 = Move(Geometry=crv, Motion=Z_6)  # -> Geometry, Transform

# ---- group: ROOF PURLIN / Axes of all directions
panel_3 = Panel("""0
90
180
270""")
rad_3 = Radians(Degrees=panel_3)
xy_6 = XYPlane(Origin=move_4.Geometry)
rotate_3 = Rotate(Geometry=move_16.Geometry, Angle=rad_3, Plane=xy_6)  # -> Geometry, Transform

# ---- group: ROOF PURLIN / Beams axis
divide = DivideCurve(Curve=rotate_3.Geometry, Count=number_slider, Kinks=False)  # -> Points, Tangents, Parameters

# ---- group: BEAMS / Flange side curves
expression_8 = Expression(x=x_y_size, factor=width_section, Expression="(x / 2) * factor")
subtraction_3 = Subtraction(A=expression_2, B=expression_8)
addition_4 = Addition(A=expression, B=expression_8)
Y_3 = UnitY(Factor=subtraction_3)
Y_4 = UnitY(Factor=addition_4)
move_17 = Move(Geometry=move_15.Geometry, Motion=Y_3)  # -> Geometry, Transform
move_18 = Move(Geometry=move_15.Geometry, Motion=Y_4)  # -> Geometry, Transform

# ---- group: CURVED STRUCTURE / WEB / Intersection
nurbs_2 = NurbsCurve(Vertices=[move_8.Geometry, move_9.Geometry, move_7.Geometry, move_10.Geometry], Degree=3, Periodic=False)  # -> Curve, Length, Domain
ln_5 = Line(StartPoint=move_12.Geometry, EndPoint=move_13.Geometry)
clx = CurveLine(Curve=nurbs_2.Curve, Line=ln_5)  # -> Points, Params, Count

# ---- group: CANOPY GLASS / Move up roof structure
expression_9 = Expression(x=height_2, Expression="x / 2")
Z_7 = UnitZ(Factor=expression_9)
move_19 = Move(Geometry=roof_structure_points, Motion=Z_7)  # -> Geometry, Transform

# ---- group: CANOPY GLASS / Move up beam
addition_5 = Addition(A=height_3, B=flange_thickness)
Z_8 = UnitZ(Factor=addition_5)
move_20 = Move(Geometry=beams_points, Motion=Z_8)  # -> Geometry, Transform
move_21 = Move(Geometry=central_point, Motion=Z_8)  # -> Geometry, Transform

# ---- group: ROOF STRUCTURE / Structure rail
ln_6 = Line(StartPoint=move_4.Geometry, EndPoint=move_11.Geometry)  # -> graft(Line)

# ---- group: ROOF PURLIN / Roof structure axis
divide_2 = DivideCurve(Curve=ln_6, Count=number_slider, Kinks=False)  # -> Points, Tangents, Parameters

# ---- group: ROOF PURLIN / Roof purlin axis
bang = ExplodeTree(Data=divide_2.Points)  # -> Branch0, Branch1, Branch2, Branch3
bang_2 = ExplodeTree(Data=divide.Points)  # -> Branch0, Branch1, Branch2, Branch3
ln_7 = Line(StartPoint=bang_2.Branch3, EndPoint=[bang.Branch0, bang.Branch1])
ln_8 = Line(StartPoint=bang_2.Branch1, EndPoint=[bang.Branch2, bang.Branch3])
ln_9 = Line(StartPoint=bang_2.Branch2, EndPoint=[bang.Branch3, bang.Branch0])
ln_10 = Line(StartPoint=bang_2.Branch0, EndPoint=[bang.Branch1, bang.Branch2])

# ---- group: ROOF PURLIN / Roof purlin surface
pipe = Pipe(Curve=[ln_10, ln_8, ln_9, ln_7], Radius=number_slider_2, Caps=0)

# ---- group: CURVED STRUCTURE / WEB / shatter arc and select first segment
shatter = Shatter(Curve=nurbs_2.Curve, Parameters=clx.Params)
item = ListItem(List=shatter, Index="1", Wrap=True)

# ---- group: CURVED STRUCTURE / TOP FLANGE / Shatter arc and select segment
shatter_2 = Shatter(Curve=graft([right_curve, left_curve]), Parameters=pcx.ParamsC)
item_2 = TreeItem(Tree=shatter_2, Path="{0;0;0}", Index="1", Wrap=True)
item_3 = TreeItem(Tree=shatter_2, Path="{0;1;0}", Index="1", Wrap=True)

# ---- group: BEAMS / Flange surface
loft_2 = Loft(
    Curves=[move_17.Geometry, move_18.Geometry],
    Options={Adjust=False, Closed=False, LoftEnds=0, LoftSimp=0, LoftType=0, Rebuild=10, Refit=0.01})
Z_9 = UnitZ(Factor=flange_thickness)
extr = Extrude(Base=loft_2, Direction=Z_9)

# ---- group: BEAMS / Web surface
expression_10 = Expression(x=web_thickness, Expression="-x / 2")
expression_11 = Expression(x=web_thickness, Expression="x / 2")
Y_5 = UnitY(Factor=expression_10)
Y_6 = UnitY(Factor=expression_11)
extr_2 = Extrude(Base=loft, Direction=[Y_5, Y_6])

# ---- group: ROOF STRUCTURE / Structure surface
swp1 = Sweep1(Rail=ln_6, Sections=rectangle_2.Rectangle, Miter=1)

# ---- group: CURVED STRUCTURE / TOP FLANGE / Brackets lines
branch = TreeBranch(Tree=pcx.Points, Path="{0;0}", MaintainPaths=True)
branch_2 = TreeBranch(Tree=pcx.Points, Path="{0;1}", MaintainPaths=True)
ln_11 = Line(StartPoint=box_corners.CornerG, EndPoint=branch)
ln_12 = Line(StartPoint=box_corners.CornerF, EndPoint=branch_2)

# ---- group: CURVED STRUCTURE / WEB / Second segment
line = Line(StartPoint=move_12.Geometry, EndPoint=clx.Points)

# ---- group: CANOPY GLASS / Rotate axes to match
shift = ShiftList(List=move_19.Geometry, Shift="2", Wrap=True)
shift_2 = ShiftList(List=move_19.Geometry, Shift="1", Wrap=True)

# ---- group: CURVED STRUCTURE / WEB / shatter arc and select segment
clx_2 = CurveLine(Curve=item, Line=ln_4)  # -> Points, Params, Count
shatter_3 = Shatter(Curve=item, Parameters=clx_2.Params)
item_4 = ListItem(List=shatter_3, Index="0", Wrap=True)

# ---- group: CURVED STRUCTURE / BOTTOM SURFACE
flange_central_curve = Curve(item_4)

# ---- group: CURVED STRUCTURE / BOTTOM SURFACE / Flange side curves
expression_12 = Expression(x=x_y_size, factor=width_section, Expression="(x / 2) * factor")
subtraction_4 = Subtraction(A=expression_2, B=expression_12)
addition_6 = Addition(A=expression, B=expression_12)
Y_7 = UnitY(Factor=subtraction_4)
Y_8 = UnitY(Factor=addition_6)
move_22 = Move(Geometry=flange_central_curve, Motion=Y_7)  # -> Geometry, Transform
move_23 = Move(Geometry=flange_central_curve, Motion=Y_8)  # -> Geometry, Transform

# ---- group: CURVED STRUCTURE / BOTTOM SURFACE / Flange surface
loft_3 = Loft(
    Curves=[move_22.Geometry, move_23.Geometry],
    Options={Adjust=False, Closed=False, LoftEnds=0, LoftSimp=0, LoftType=0, Rebuild=10, Refit=0.01})
neg_5 = Negative(Value=flange_thickness)
X_4 = UnitX(Factor=neg_5)
extr_3 = Extrude(Base=loft_3, Direction=X_4)

# ---- group: CANOPY GLASS / Surface modules
srf4pt = _4PointSurface(CornerA=move_21.Geometry, CornerB=shift, CornerC=move_20.Geometry)
srf4pt_2 = _4PointSurface(CornerA=move_21.Geometry, CornerB=shift_2, CornerC=move_20.Geometry)

# ---- group: CANOPY GLASS / Canopy glass surface
merge = Merge(Data1=srf4pt, Data2=srf4pt_2)
Z_10 = UnitZ(Factor=thickness)
extr_4 = Extrude(Base=merge, Direction=Z_10)

# ---- group: CURVED STRUCTURE / TOP FLANGE / Top flange curve generation
join = JoinCurves(Curves=flatten([ln_11, item_2]), Preserve=False)
join_2 = JoinCurves(Curves=flatten([ln_12, item_3]), Preserve=False)

# ---- group: CURVED STRUCTURE / TOP FLANGE
loft_4 = Loft(Curves=[join_2, join], Options={Adjust=False, Closed=False, LoftEnds=0, LoftSimp=0, LoftType=0, Rebuild=10, Refit=0.01})

# ---- group: CURVED STRUCTURE / Flange surface
neg_6 = Negative(Value=flange_thickness)
X_5 = UnitX(Factor=neg_6)
extr_5 = Extrude(Base=loft_4, Direction=X_5)

# ---- group: CURVED STRUCTURE / WEB / Web genration
join_3 = JoinCurves(Curves=flatten([item_4, line]), Preserve=False)
move_24 = Move(Geometry=central_curve, Motion=X_5)  # -> Geometry, Transform
edgesrf = EdgeSurface(CurveA=move_24.Geometry, CurveB=join_3)

# ---- group: STRUCTURE CURVED PURLIN
central_curve_axis = Curve(move_24.Geometry)
intersection_point = Data(clx.Points)

# ---- group: STRUCTURE CURVED PURLIN / (Avoid protruding surfaces)
X_6 = UnitX(Factor=number_slider_2)
neg_7 = Negative(Value=X_6)
move_25 = Move(Geometry=central_curve_axis, Motion=neg_7)  # -> Geometry, Transform

# ---- group: STRUCTURE CURVED PURLIN / Curves of all directions
panel_4 = Panel("""0
90
180
270""")
rad_4 = Radians(Degrees=panel_4)
xy_7 = XYPlane(Origin=move_4.Geometry)
rotate_4 = Rotate(Geometry=move_25.Geometry, Angle=rad_4, Plane=xy_7)  # -> Geometry, Transform

# ---- group: STRUCTURE CURVED PURLIN / Find curve parameters at given height
xy_8 = XYPlane(Origin=intersection_point)
graft = GraftTree(Tree=rotate_4.Geometry, IncludeEmptyLists=True, IncludeNullItems=True)
pcx_2 = CurvePlane(Curve=rotate_4.Geometry, Plane=xy_8)  # -> Points, ParamsC, ParamsP

# ---- group: STRUCTURE CURVED PURLIN / Shatter arc and select segment
shatter_4 = Shatter(Curve=graft, Parameters=pcx_2.ParamsC)
item_5 = ListItem(List=shatter_4, Index="1", Wrap=True)

# ---- group: CURVED STRUCTURE / WEB / Web surface
expression_13 = Expression(x=web_thickness, Expression="-x / 2")
expression_14 = Expression(x=web_thickness, Expression="x / 2")
Y_9 = UnitY(Factor=expression_13)
Y_10 = UnitY(Factor=expression_14)
extr_6 = Extrude(Base=edgesrf, Direction=[Y_9, Y_10])

# ---- group: STRUCTURE CURVED PURLIN
curves_for_straps = Curve(item_5)
beam_of_rail = Curve(ln_6)

# ---- group: STRUCTURE CURVED PURLIN / Structure curve axis
divide_3 = DivideCurve(Curve=curves_for_straps, Count=number_slider, Kinks=False)  # -> Points, Tangents, Parameters

# ---- group: STRUCTURE CURVED PURLIN / Roof structure axis
divide_4 = DivideCurve(Curve=beam_of_rail, Count=number_slider, Kinks=False)  # -> Points, Tangents, Parameters

# ---- group: STRUCTURE CURVED PURLIN / Curved structure purlin
bang_3 = ExplodeTree(Data=divide_4.Points)  # -> Branch0, Branch1, Branch2, Branch3
bang_4 = ExplodeTree(Data=divide_3.Points)  # -> _0000, _0100, _0200, _0300
ln_13 = Line(StartPoint=bang_4._0100, EndPoint=[bang_3.Branch2, bang_3.Branch3])
ln_14 = Line(StartPoint=bang_4._0200, EndPoint=[bang_3.Branch3, bang_3.Branch0])
ln_15 = Line(StartPoint=bang_4._0000, EndPoint=[bang_3.Branch1, bang_3.Branch2])
ln_16 = Line(StartPoint=bang_4._0300, EndPoint=[bang_3.Branch0, bang_3.Branch1])

# ---- group: STRUCTURE CURVED PURLIN / Purlin surface of curved structures
pipe_2 = Pipe(Curve=[ln_15, ln_13, ln_14, ln_16], Radius=number_slider_2, Caps=0)

# ---- group: Curved structures and beams srotation
panel_5 = Panel("""90
180
270""")
xy_9 = XYPlane(Origin=midpt_3)
rad_5 = Radians(Degrees=panel_5)
rotate_5 = Rotate(Geometry=graft([extr_6, extr_5, extr_3, extr_2, extr]), Angle=rad_5, Plane=xy_9)  # -> Geometry, Transform

# ---- group: Purlins
brep_2 = Brep([pipe, pipe_2])

# ---- group: Cnopy glass
brep_3 = Brep(extr_4)

# ---- group: Mother curved structure and beams
brep_4 = Brep([extr_5, extr_6, extr_3, extr_2, extr])

# ---- group: Structure roof and mast
brep_5 = Brep([swp1, cyl])

# ---- group: Final Brep
merge_2 = Merge(Data1=brep_4, Data2=rotate_5.Geometry, Data3=brep_5, Data4=brep_2, Data5=brep_3)
brep_6 = Brep(graft(merge_2))

# ---- group: Representation
swatch = ColourSwatch(SwatchColor=RGB(5, 242, 207))
material = CreateMaterial(Diffuse="Metal", Specular="White", Emission="White", Transparency=0, Shine=0)
material_2 = CreateMaterial(Diffuse="Glass", Specular=swatch, Emission=swatch, Transparency=Slider(0.96, range=0..1), Shine=0)
preview = CustomPreview(Geometry=brep_3, Material=material_2)  # disabled
preview_2 = CustomPreview(Geometry=[brep, merge_2], Material=material)  # disabled

# ---- group: MODULE UNIONS / Roof purlin axis
line_2 = Line(ln_8)
line_3 = Line(ln_10)

# ---- group: MODULE UNIONS / Select edge axis
int = Integer(number_slider)
item_6 = ListItem(List=line_3, Index=int, Wrap=True)
item_7 = ListItem(List=line_2, Index=int, Wrap=True)

# ---- group: ON SITE IMPLEMENTATION / SURFACES / Main grille
expression_15 = Expression(x=x_y_size, y=x_final_point, z=width, Expression="x + (y * 2) + z")
sqgrid = Square(Plane=evalsrf.Point, Size=expression_15, ExtentX=expression_3, ExtentY=expression_4)  # -> Cells, flatten(Points)

# ---- group: ON SITE IMPLEMENTATION / SURFACES / Grids for joints
expression_16 = Expression(x=expression_3, Expression="X - 1")
expression_17 = Expression(y=expression_4, Expression="y - 1")
sqgrid_2 = Square(Plane=evalsrf.Point, Size=expression_15, ExtentX=expression_16, ExtentY=expression_4)  # -> Cells, flatten(Points)
sqgrid_3 = Square(Plane=evalsrf.Point, Size=expression_15, ExtentX=expression_3, ExtentY=expression_17)  # -> Cells, flatten(Points)
sqgrid_4 = Square(Plane=evalsrf.Point, Size=expression_15, ExtentX=expression_16, ExtentY=expression_17)  # -> Cells, flatten(Points)

# ---- group: MODULE UNIONS / Level to edge of purlins
Z_11 = UnitZ(Factor=number_slider_2)
move_26 = Move(Geometry=item_7, Motion=Z_11)  # -> Geometry, Transform
move_27 = Move(Geometry=item_6, Motion=Z_11)  # -> Geometry, Transform

# ---- group: ON SITE IMPLEMENTATION / BASES / Intersection of mesh with grid
Z_12 = UnitZ(Factor=1)
neg_8 = Negative(Value=Z_12)
Z_13 = UnitZ(Factor=1)
meshray = MeshRay(Mesh=mesh_uv, Point=sqgrid.Points, Direction=neg_8)  # -> Point, Hit
meshray_2 = MeshRay(Mesh=mesh_uv, Point=sqgrid.Points, Direction=Z_13)  # -> Point, Hit
below_grid = Point(meshray.Point)
above_grid = Point(meshray_2.Point)
pdecon_2 = Deconstruct(Point=below_grid)  # -> XComponent, YComponent, ZComponent
pdecon_3 = Deconstruct(Point=above_grid)  # -> XComponent, YComponent, ZComponent

# ---- group: UNION CENTER / Points roof structure axis
pt_4 = Point(divide_2.Points)

# ---- group: UNION CENTER / Select one corner
flatten = FlattenTree(Tree=pt_4, Path="{0}")
item_8 = ListItem(List=flatten, Index="35", Wrap=True)

# ---- group: MODULE UNIONS / Parallel edge generation
Y_11 = UnitY(Factor=width)
X_7 = UnitX(Factor=width)
move_28 = Move(Geometry=move_26.Geometry, Motion=Y_11)  # -> Geometry, Transform
move_29 = Move(Geometry=move_27.Geometry, Motion=X_7)  # -> Geometry, Transform

# ---- group: ON SITE IMPLEMENTATION / SURFACES / Structure groups
orient = Orient(Geometry=brep_6, Source=xy, Target=sqgrid.Points)  # -> Geometry, Transform

# ---- group: UNION CENTER / Opposite corner generation
vec_4 = VectorXYZ(XComponent=width, YComponent=width, ZComponent=height_4)  # -> Vector, Length
move_30 = Move(Geometry=item_8, Motion=vec_4.Vector)  # -> Geometry, Transform

# ---- group: MODULE UNIONS / Flat bases
loft_5 = Loft(
    Curves=[move_26.Geometry, move_28.Geometry],
    Options={Adjust=False, Closed=False, LoftEnds=0, LoftSimp=0, LoftType=0, Rebuild=10, Refit=0.01})
loft_6 = Loft(
    Curves=[move_27.Geometry, move_29.Geometry],
    Options={Adjust=False, Closed=False, LoftEnds=0, LoftSimp=0, LoftType=0, Rebuild=10, Refit=0.01})

# ---- group: MODULE UNIONS / Surfaces generation
Z_14 = UnitZ(Factor=height_4)
extr_7 = Extrude(Base=loft_6, Direction=Z_14)
extr_8 = Extrude(Base=loft_5, Direction=Z_14)

# ---- group: UNION CENTER / Surface generation
xy_10 = XYPlane(Origin=Point(0, 0, 0))
box_2 = Box2Pt(PointA=item_8, PointB=move_30.Geometry, Plane=xy_10)

# ---- group: ON SITE IMPLEMENTATION / SURFACES / Individual unions
module_joints_y = Brep(graft(extr_8))
module_joints = Brep(graft(extr_7))
union_centre = Brep(graft(box_2))

# ---- group: ON SITE IMPLEMENTATION / SURFACES / Group unions
orient_2 = Orient(Geometry=module_joints, Source=xy, Target=sqgrid_2.Points)  # -> Geometry, Transform
orient_3 = Orient(Geometry=module_joints_y, Source=xy, Target=sqgrid_3.Points)  # -> Geometry, Transform
orient_4 = Orient(Geometry=union_centre, Source=xy, Target=sqgrid_4.Points)  # -> Geometry, Transform

# ---- group: ON SITE IMPLEMENTATION / BASES / Height of the base adding or subtracting differences
null = NullItem(Item=pdecon_3.ZComponent)  # -> NullFlags, InvalidFlags, Description
dispatch = Dispatch(List=pdecon_3.ZComponent, DispatchPattern=null.NullFlags)  # -> ListA, ListB
pdecon_4 = Deconstruct(Point=sqgrid.Points)  # -> XComponent, YComponent, ZComponent
nullrep = ReplaceNulls(Items=pdecon_2.ZComponent, Replacements=dispatch.ListB)  # -> Items, Count
subtraction_5 = Subtraction(A=pdecon_4.ZComponent, B=nullrep.Items)
addition_7 = Addition(A=base_height, B=subtraction_5)
panel_6 = Panel(subtraction_5)

# ---- group: ON SITE IMPLEMENTATION / BASES / Valid origin points from both lists
null_2 = NullItem(Item=above_grid)  # -> NullFlags, InvalidFlags, Description
dispatch_2 = Dispatch(List=above_grid, DispatchPattern=null_2.NullFlags)  # -> ListA, ListB
nullrep_2 = ReplaceNulls(Items=below_grid, Replacements=dispatch_2.ListB)  # -> Items, Count

# ---- group: ON SITE IMPLEMENTATION / BASES / Construct bases
expression_18 = Expression(x=x_y_size, Expression="- x / 2")
expression_19 = Expression(x=x_y_size, Expression="+ x / 2")
xy_11 = XYPlane(Origin=nullrep_2.Items)
dom_5 = ConstructDomain(DomainStart=expression_19, DomainEnd=expression_18)
box_3 = DomainBox(Base=xy_11, X=dom_5, Y=dom_5, Z=addition_7)

# ---- group: Bases
brep_7 = Brep(box_3)

# ---- group: Main structure
brep_8 = Brep(orient.Geometry)

# ---- group: Union structure
brep_9 = Brep([orient_2.Geometry, orient_3.Geometry, orient_4.Geometry])

# ---- group: Final land breps
merge_3 = Merge(Data1=brep_7, Data2=brep_8, Data3=brep_9)
brep_10 = Brep(flatten(merge_3))

# ----
material_3 = CreateMaterial(Diffuse="Metal", Specular="White", Emission="White", Transparency=0, Shine=0)
preview_3 = CustomPreview(Geometry=brep_10, Material=material_3)
